# Grasshopper definition W3_Surface.gh (Grasshopper 0.9.70)

base_surface = Surface(<surface referenced from the Rhino model>)

maximum_aperture = Slider(0.14, range=0..1)
minimum_aperture = Slider(0.25, range=0..0.5)
v_subdivisions = Slider(15, range=0..100)
u_subdivisions = Slider(10, range=0..100)
radius = Slider(2.25, range=0..10)
attractor_point = Point(<point referenced from the Rhino model>)
base_surface_2 = Surface(base_surface)

# ---- group: Triangulation
divide = DivideDomain²(Domain=base_surface_2, UCount=expr("x/2", u_subdivisions), VCount=expr("x/2", v_subdivisions))
subsrf = Isotrim(Surface=base_surface_2, Domain=divide)
explode = BrepComponents(Brep=subsrf)  # -> Faces, Edges, Vertices
item = ListItem(List=explode.Vertices, Index="3", Wrap=True)
item_2 = ListItem(List=explode.Vertices, Index="0", Wrap=True)
item_3 = ListItem(List=explode.Vertices, Index="1", Wrap=True)
item_4 = ListItem(List=explode.Vertices, Index="2", Wrap=True)
srf4pt = _4PointSurface(CornerA=item_2, CornerB=item_3, CornerC=item_4)  # -> flatten(Surface)
srf4pt_2 = _4PointSurface(CornerA=item_4, CornerB=item, CornerC=item_2)  # -> flatten(Surface)
weave = Weave(Pattern=[0, 1], Stream0=srf4pt, Stream1=srf4pt_2, NullGaps=False)

# ----
int = Integer(v_subdivisions)
attractor_point_2 = Point(attractor_point)

area = Area(Geometry=weave)  # -> Area, Centroid
dist = Distance(PointA=attractor_point_2, PointB=area.Centroid)
sort = SortList(Keys=dist)  # -> Keys, ValuesA
item_5 = ListItem(List=sort.Keys, Index="0", Wrap=True)
_1 = Number(1)
division = Division(A=_1, B=item_5)
multiplication = Multiplication(A=division, B=dist)
min = Minimum(A=multiplication, B=maximum_aperture)
max = Maximum(A=min, B=minimum_aperture)
scale = Scale(Geometry=weave, Center=area.Centroid, Factor=max)  # -> Geometry, Transform
wires = BrepWireframe(Brep=weave, Density=-1)
wires_2 = BrepWireframe(Brep=scale.Geometry, Density=-1)
join = JoinCurves(Curves=wires_2, Preserve=False)
join_2 = JoinCurves(Curves=wires, Preserve=False)
weave_2 = Weave(Pattern=[0, 1], Stream0=join_2, Stream1=join, NullGaps=False)
loft = Loft(Curves=weave_2, Options={Adjust=False, Closed=False, LoftEnds=0, LoftSimp=0, LoftType=0, Rebuild=10, Refit=0.01})

brep = Brep(flatten(loft))
int_2 = Integer(int)
partition = PartitionList(List=brep, Size=int_2)  # -> simplify(Chunks)
num = Number(radius)
num_2 = Number(radius)
num_3 = Number(radius)
debrep = DeconstructBrep(Brep=partition)  # -> Faces, Edges, Vertices
item_6 = ListItem(List=debrep.Faces, Index="2", Wrap=True)
item_7 = ListItem(List=debrep.Faces, Index="0", Wrap=True)
item_8 = ListItem(List=debrep.Faces, Index="1", Wrap=True)

# ---- group: Untrimmed Surface
join_3 = BrepJoin(Breps=flatten(item_8))  # -> Breps, Closed
txt = Text(join_3.Breps)
eval = Evaluate(F="Contains(x, \"Surface\")", x=txt)
cull = CullPattern(List=join_3.Breps, CullPattern=eval)
brep_2 = Brep(cull)

# ---- group: Removing Untrimmed Surface
join_4 = BrepJoin(Breps=flatten(item_8))  # -> Breps, Closed
txt_2 = Text(join_4.Breps)
eval_2 = Evaluate(F="Contains(x, \"Brep\")", x=txt_2)
cull_2 = CullPattern(List=join_4.Breps, CullPattern=eval_2)
brep_3 = Brep(cull_2)

join_5 = BrepJoin(Breps=flatten(item_6))  # -> Breps, Closed
txt_3 = Text(join_5.Breps)
eval_3 = Evaluate(F="Contains(x, \"Brep\")", x=txt_3)
cull_3 = CullPattern(List=join_5.Breps, CullPattern=eval_3)
brep_4 = Brep(cull_3)

# ---- group: Untrimmed Surface
join_6 = BrepJoin(Breps=flatten(item_6))  # -> Breps, Closed
txt_4 = Text(join_6.Breps)
eval_4 = Evaluate(F="Contains(x, \"Surface\")", x=txt_4)
cull_4 = CullPattern(List=join_6.Breps, CullPattern=eval_4)
brep_5 = Brep(cull_4)

# ----
panel = Panel(item_8)

# ---- group: Adding joinery element
join_7 = BrepJoin(Breps=flatten(item_7))  # -> Breps, Closed
edges = BrepEdges(Brep=join_7.Breps)  # -> Naked, Interior, NonManifold
eval_5 = EvaluateCurve(Curve=reparameterize(edges.Interior), Parameter=0.5)  # -> Point, Tangent, Angle
pt = ConstructPoint(XCoordinate=".5", YCoordinate=".5", ZCoordinate=0)
debrep_2 = DeconstructBrep(Brep=join_7.Breps)  # -> Faces, Edges, Vertices
evalsrf = EvaluateSurface(Surface=reparameterize(debrep_2.Faces), Point=pt)  # -> Point, Normal, Frame
srf = Surface(debrep_2.Faces)
brep_6 = Brep(join_7.Breps)
dispatch = Dispatch(List=evalsrf.Normal, DispatchPattern=[True, False])  # -> ListA, ListB
xprod = CrossProduct(VectorA=dispatch.ListA, VectorB=dispatch.ListB, Unitize=False)  # -> Vector, Length
pl = PlaneNormal(Origin=eval_5.Point, ZAxis=xprod.Vector)
sec = BrepPlane(Brep=debrep_2.Faces, Plane=pl)  # -> Curves, Points
explode_2 = Explode(Curve=sec.Curves, Recursive=True)  # -> simplify(Segments), Vertices
pshift = ShiftPaths(Data=explode_2.Segments, Offset=-1)
len = Length(Curve=pshift)
num_4 = Number(num_2)
num_5 = Number(num_4)

# ---- group: Adding joinery element / sort list to select minimum value for the radius
sort_2 = SortList(Keys=len)  # -> Keys, ValuesA

# ---- group: Adding joinery element
edges_2 = BrepEdges(Brep=brep_3)  # -> Naked, Interior, NonManifold
eval_6 = EvaluateCurve(Curve=reparameterize(edges_2.Interior), Parameter=0.5)  # -> Point, Tangent, Angle
pt_2 = ConstructPoint(XCoordinate=".5", YCoordinate=".5", ZCoordinate=0)
debrep_3 = DeconstructBrep(Brep=brep_3)  # -> Faces, Edges, Vertices
brep_7 = Brep(brep_3)
srf_2 = Surface(debrep_3.Faces)
evalsrf_2 = EvaluateSurface(Surface=reparameterize(debrep_3.Faces), Point=pt_2)  # -> Point, Normal, Frame
dispatch_2 = Dispatch(List=evalsrf_2.Normal, DispatchPattern=[True, False])  # -> ListA, ListB
xprod_2 = CrossProduct(VectorA=dispatch_2.ListA, VectorB=dispatch_2.ListB, Unitize=False)  # -> Vector, Length
pl_2 = PlaneNormal(Origin=eval_6.Point, ZAxis=xprod_2.Vector)
sec_2 = BrepPlane(Brep=debrep_3.Faces, Plane=pl_2)  # -> Curves, Points
explode_3 = Explode(Curve=sec_2.Curves, Recursive=True)  # -> simplify(Segments), Vertices
pshift_2 = ShiftPaths(Data=explode_3.Segments, Offset=-1)
len_2 = Length(Curve=pshift_2)
num_6 = Number(num)
num_7 = Number(num_6)

# ---- group: Adding joinery element / sort list to select minimum value for the radius
sort_3 = SortList(Keys=len_2)  # -> Keys, ValuesA

# ---- group: Adding joinery element
edges_3 = BrepEdges(Brep=brep_4)  # -> Naked, Interior, NonManifold
eval_7 = EvaluateCurve(Curve=reparameterize(edges_3.Interior), Parameter=0.5)  # -> Point, Tangent, Angle
pt_3 = ConstructPoint(XCoordinate=".5", YCoordinate=".5", ZCoordinate=0)
debrep_4 = DeconstructBrep(Brep=brep_4)  # -> Faces, Edges, Vertices
brep_8 = Brep(brep_4)
evalsrf_3 = EvaluateSurface(Surface=reparameterize(debrep_4.Faces), Point=pt_3)  # -> Point, Normal, Frame
srf_3 = Surface(debrep_4.Faces)
dispatch_3 = Dispatch(List=evalsrf_3.Normal, DispatchPattern=[True, False])  # -> ListA, ListB
xprod_3 = CrossProduct(VectorA=dispatch_3.ListA, VectorB=dispatch_3.ListB, Unitize=False)  # -> Vector, Length
pl_3 = PlaneNormal(Origin=eval_7.Point, ZAxis=xprod_3.Vector)
sec_3 = BrepPlane(Brep=debrep_4.Faces, Plane=pl_3)  # -> Curves, Points
explode_4 = Explode(Curve=sec_3.Curves, Recursive=True)  # -> simplify(Segments), Vertices
pshift_3 = ShiftPaths(Data=explode_4.Segments, Offset=-1)
len_3 = Length(Curve=pshift_3)
num_8 = Number(num_3)
num_9 = Number(num_8)

# ---- group: Adding joinery element / sort list to select minimum value for the radius
sort_4 = SortList(Keys=len_3)  # -> Keys, ValuesA

# ---- group: Adding joinery element (continued)
item_9 = ListItem(List=sort_4.Keys, Index=0, Wrap=True)
division_2 = Division(A=item_9, B="2")
cir = Circle(Plane=simplify(pl_3), Radius=division_2)
boundary = BoundarySurfaces(Edges=cir)
srf_4 = Surface(boundary)
bbx = BrepBrep(BrepA=graft(brep_8), BrepB=boundary)  # -> simplify(Curves), Points
explode_5 = Explode(Curve=bbx.Curves, Recursive=True)  # -> Segments, Vertices
eval_8 = EvaluateLength(Curve=explode_5.Segments, Length=0.5, Normalized=True)  # -> Point, Tangent, Parameter
shatter = Shatter(Curve=explode_5.Segments, Parameters=eval_8.Parameter)  # -> simplify(Segments)
tstat = TreeStatistics(Tree=shatter)  # -> Paths, Length, Count
dispatch_4 = Dispatch(List=tstat.Paths, DispatchPattern=[True, False])  # -> ListA, ListB
branch = TreeBranch(Tree=shatter, Path=dispatch_4.ListA, MaintainPaths=True)
branch_2 = TreeBranch(Tree=shatter, Path=dispatch_4.ListB, MaintainPaths=True)
rev = ReverseList(List=branch_2)
item_10 = ListItem(List=[branch, rev], Index=0, Wrap=True)  # -> Item, Item1
crv = Curve(item_10.Item)
crv_2 = Curve(item_10.Item1)
join_8 = JoinCurves(Curves=crv_2, Preserve=False)
pshift_4 = ShiftPaths(Data=join_8, Offset=-1)
pshift_5 = ShiftPaths(Data=pshift_4, Offset=-1)

# ---- group: Adding joinery element / Circle
pipe = Pipe(Curve=crv, Radius=num_9, Caps=1)  # -> simplify(Pipe)
pshift_6 = ShiftPaths(Data=pipe, Offset=-1)
bbx_2 = BrepBrep(BrepA=srf_4, BrepB=pshift_6)  # -> Curves, Points
pshift_7 = ShiftPaths(Data=bbx_2.Curves, Offset=-1)
srfsplit = SurfaceSplit(Surface=srf_4, Curves=pshift_7)
item_11 = ListItem(List=srfsplit, Index=0, Wrap=True)

# ---- group: Adding joinery element / Triangle
pipe_2 = Pipe(Curve=pshift_5, Radius=num_9, Caps=1)  # -> simplify(Pipe)
pshift_8 = ShiftPaths(Data=pipe_2, Offset=-1)
srf_5 = Surface(simplify(srf_3))
brep_9 = Brep(graft(brep_8))
bbx_3 = BrepBrep(BrepA=brep_9, BrepB=pshift_8)  # -> Curves, Points
pshift_9 = ShiftPaths(Data=bbx_3.Curves, Offset=-1)
srfsplit_2 = SurfaceSplit(Surface=srf_5, Curves=pshift_9)
item_12 = ListItem(List=srfsplit_2, Index=0, Wrap=True)

# ---- group: Adding joinery element (continued)
item_13 = ListItem(List=sort_3.Keys, Index=0, Wrap=True)
division_3 = Division(A=item_13, B="2")
cir_2 = Circle(Plane=simplify(pl_2), Radius=division_3)
boundary_2 = BoundarySurfaces(Edges=cir_2)
srf_6 = Surface(boundary_2)
bbx_4 = BrepBrep(BrepA=graft(brep_7), BrepB=boundary_2)  # -> simplify(Curves), Points
explode_6 = Explode(Curve=bbx_4.Curves, Recursive=True)  # -> Segments, Vertices
eval_9 = EvaluateLength(Curve=explode_6.Segments, Length=0.5, Normalized=True)  # -> Point, Tangent, Parameter
shatter_2 = Shatter(Curve=explode_6.Segments, Parameters=eval_9.Parameter)  # -> simplify(Segments)
tstat_2 = TreeStatistics(Tree=shatter_2)  # -> Paths, Length, Count
dispatch_5 = Dispatch(List=tstat_2.Paths, DispatchPattern=[True, False])  # -> ListA, ListB
branch_3 = TreeBranch(Tree=shatter_2, Path=dispatch_5.ListA, MaintainPaths=True)
branch_4 = TreeBranch(Tree=shatter_2, Path=dispatch_5.ListB, MaintainPaths=True)

# ----
rev_2 = ReverseList(List=branch_4)

# ---- group: Adding joinery element (continued)
item_14 = ListItem(List=sort_2.Keys, Index=0, Wrap=True)
division_4 = Division(A=item_14, B="2")
cir_3 = Circle(Plane=simplify(pl), Radius=division_4)
boundary_3 = BoundarySurfaces(Edges=cir_3)
srf_7 = Surface(boundary_3)
bbx_5 = BrepBrep(BrepA=graft(brep_6), BrepB=boundary_3)  # -> simplify(Curves), Points
explode_7 = Explode(Curve=bbx_5.Curves, Recursive=True)  # -> Segments, Vertices
eval_10 = EvaluateLength(Curve=explode_7.Segments, Length=0.5, Normalized=True)  # -> Point, Tangent, Parameter
shatter_3 = Shatter(Curve=explode_7.Segments, Parameters=eval_10.Parameter)  # -> simplify(Segments)
tstat_3 = TreeStatistics(Tree=shatter_3)  # -> Paths, Length, Count
dispatch_6 = Dispatch(List=tstat_3.Paths, DispatchPattern=[True, False])  # -> ListA, ListB
branch_5 = TreeBranch(Tree=shatter_3, Path=dispatch_6.ListA, MaintainPaths=True)
branch_6 = TreeBranch(Tree=shatter_3, Path=dispatch_6.ListB, MaintainPaths=True)
rev_3 = ReverseList(List=branch_6)
item_15 = ListItem(List=[branch_5, rev_3], Index=0, Wrap=True)  # -> Item, Item1

# ----
crv_3 = Curve(item_15.Item1)
crv_4 = Curve(item_15.Item)

# ---- group: Adding joinery element (continued)
join_9 = JoinCurves(Curves=crv_3, Preserve=False)
pshift_10 = ShiftPaths(Data=join_9, Offset=-1)
pshift_11 = ShiftPaths(Data=pshift_10, Offset=-1)

# ---- group: Adding joinery element / Circle
pipe_3 = Pipe(Curve=crv_4, Radius=num_5, Caps=1)  # -> simplify(Pipe)
pshift_12 = ShiftPaths(Data=pipe_3, Offset=-1)
bbx_6 = BrepBrep(BrepA=srf_7, BrepB=pshift_12)  # -> Curves, Points
pshift_13 = ShiftPaths(Data=bbx_6.Curves, Offset=-1)
srfsplit_3 = SurfaceSplit(Surface=srf_7, Curves=pshift_13)
item_16 = ListItem(List=srfsplit_3, Index=0, Wrap=True)

# ---- group: Adding joinery element / Triangle
pipe_4 = Pipe(Curve=pshift_11, Radius=num_5, Caps=1)  # -> simplify(Pipe)
pshift_14 = ShiftPaths(Data=pipe_4, Offset=-1)
brep_10 = Brep(graft(brep_6))
srf_8 = Surface(simplify(srf))
bbx_7 = BrepBrep(BrepA=brep_10, BrepB=pshift_14)  # -> Curves, Points
pshift_15 = ShiftPaths(Data=bbx_7.Curves, Offset=-1)
srfsplit_4 = SurfaceSplit(Surface=srf_8, Curves=pshift_15)
item_17 = ListItem(List=srfsplit_4, Index=0, Wrap=True)

# ---- group: Adding joinery element (continued)
item_18 = ListItem(List=[branch_3, rev_2], Index=0, Wrap=True)  # -> Item, Item1

# ----
crv_5 = Curve(item_18.Item)
crv_6 = Curve(item_18.Item1)

# ---- group: Adding joinery element (continued)
join_10 = JoinCurves(Curves=crv_6, Preserve=False)
pshift_16 = ShiftPaths(Data=join_10, Offset=-1)
pshift_17 = ShiftPaths(Data=pshift_16, Offset=-1)

# ---- group: Adding joinery element / Circle
pipe_5 = Pipe(Curve=crv_5, Radius=num_7, Caps=1)  # -> simplify(Pipe)
pshift_18 = ShiftPaths(Data=pipe_5, Offset=-1)
bbx_8 = BrepBrep(BrepA=srf_6, BrepB=pshift_18)  # -> Curves, Points
pshift_19 = ShiftPaths(Data=bbx_8.Curves, Offset=-1)
srfsplit_5 = SurfaceSplit(Surface=srf_6, Curves=pshift_19)
item_19 = ListItem(List=srfsplit_5, Index=0, Wrap=True)

# ---- group: Adding joinery element / Triangle
pipe_6 = Pipe(Curve=pshift_17, Radius=num_7, Caps=1)  # -> simplify(Pipe)
pshift_20 = ShiftPaths(Data=pipe_6, Offset=-1)
brep_11 = Brep(graft(brep_7))
srf_9 = Surface(simplify(srf_2))
bbx_9 = BrepBrep(BrepA=brep_11, BrepB=pshift_20)  # -> Curves, Points
pshift_21 = ShiftPaths(Data=bbx_9.Curves, Offset=-1)
srfsplit_6 = SurfaceSplit(Surface=srf_9, Curves=pshift_21)
item_20 = ListItem(List=srfsplit_6, Index=0, Wrap=True)

# ---- group: Circles
brep_12 = Brep(item_19)
brep_13 = Brep(item_16)
brep_14 = Brep(item_11)

# ---- group: Triangles
brep_15 = Brep(graft(brep_5))
brep_16 = Brep(graft(brep_2))
brep_17 = Brep(item_17)
brep_18 = Brep(item_20)
brep_19 = Brep(item_12)
